# Requirement set Transmission_Requirements (R2026a)

## 1 [#3] Engine Operating Limits
The transmission controller shall prevent operation of the engine outside its allowable operating range.

### 1.1 [#4] Maximum Engine Speed
The transmission controller shall prevent engine speed from exceeding 7250 RPM.
If engine speed exceeds 7250 RPM, request upshift to protect engine.
Rationale: Higher engine speeds will cause the internal piston forces to excess material limitations.

## 2 [#1] Gear Selection Safety
The transmission controller shall permit gear selection only when operating conditions are valid for the requested gear.

### 2.1 [#2] Park Engagement
The transmission controller shall permit engagement of PARK only when |vehSpd| < 0.1 m/s

### 2.2 [GS-01] Valid Gears Only
The manager shall command gears 1-10 only in Drive, 0 in Neutral/Park, and -1 in Reverse. Invalid candidates shall never pass.

### 2.3 [RP-01] Drive Request Speed Protection
The transmission controller shall accept a Drive request only when signed vehicle speed is strictly greater than −0.5 m/s. When Drive is requested at or below −0.5 m/s, the accepted range shall be Neutral.

### 2.4 [RP-02] Reverse Request Speed Protection
The transmission controller shall accept a Reverse request only when signed vehicle speed is strictly less than 0.5 m/s. When Reverse is requested at or above 0.5 m/s, the accepted range shall be Neutral.

### 2.5 [GS-04] 1-second Shift Timer
Upon receiving a new gear command from the controller, all further commands within a 1 second time window will be ignored.

## 3 [#9] Driver Request Handling
The transmission controller shall process driver gear requests according to transmission operating constraints.

### 3.1 [#10] Park Request Protection
The transmission controller shall always command neutral when park is selected
Rationale: If the transmission is in any drive or reverse gears it will cause undue strain on the engine and torque converter.

## 4 [#11] Vehicle Performance
The vehicle shall accelerate from 0 to 60 mph in less than 12 seconds when wide-open-throttle is applied (100% throttle)
Rationale: If 0-60 acceleration time is greater than 12 seconds it will create unsafe situations on the road during merging and other high-acceleration manoeuvers.